% Simulink data dictionary MyParams.sldd
% references TestConfig.sldd

Configuration = Simulink.ConfigSet(StartTime="0", StopTime="10", FixedStep="0.1", Solver="FixedStepDiscrete", ProdHWDeviceType="Intel->x86-64 (Windows64)", SystemTargetFile="cigre.tlc", TargetLang="C")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
ps = Simulink.Parameter(struct(p1=1, psi=struct(psi1=1)), StorageClass="SimulinkGlobal")
p1 = Simulink.Parameter([1 2; 3 4], StorageClass="SimulinkGlobal", DataType="int8")
ddParam = Simulink.Parameter(2, StorageClass="SimulinkGlobal")
ps_p1 = Simulink.Parameter(1, StorageClass="SimulinkGlobal", DataType="int8")